% Simulink data dictionary c63_w204_v6_params.sldd

C63_W204_V6 = struct(
  schema="jovi.engine_sound.v6",
  name="c63_w204",
  display_name="Mercedes-Benz W204 C63 AMG M156 V8",
  seed=6306,
  audio=struct(sample_rate_hz=96000, export_sample_rate_hz=48000, peak_limit=0.89, master_gain=0.98),
  engine=struct(
    cylinders=8,
    cycle_revolutions=2,
    displacement_l=6.208,
    bore_m=0.1022,
    stroke_m=0.0946,
    compression_ratio=11.3,
    idle_rpm=700,
    redline_rpm=7200,
    firing_order=[1 5 4 2 6 3 7 8],
    bank_by_cylinder=[1 2 1 2 1 2 1 2],
    torque_rpm=[700 1500 2500 3500 4500 5000 6000 6800 7200],
    torque_nm=[280 390 500 555 590 600 550 472 430],
    wiebe_a=5,
    wiebe_m=2,
    combustion_duration_deg=48,
    evo_deg_bbdc=50,
    equivalent_inertia_kgm2=0.22),
  driveline=struct(
    gear_ratios=[4.38 2.86 1.92],
    final_drive=2.85,
    wheel_radius_m=0.335,
    launch_rpm=2300,
    max_accel_mps2=7.2,
    shift_rpm=7000,
    shift_attack_s=0.018,
    shift_hold_s=0.032,
    shift_recovery_s=0.075,
    shift_settle_s=0.055,
    shift_min_torque=0.22,
    shift_reengage_gain=1.08),
  ecu=struct(
    full_load_spark_deg=[8 16 21 24 25],
    spark_rpm=[700 2000 4000 6000 7200],
    full_load_lambda=0.87,
    dfco_throttle=0.06,
    dfco_rpm=2200,
    dfco_delay_s=0.12,
    fuel_film_tau_s=0.18),
  thermal=struct(
    load_axis=[0.1 0.4 0.7 1],
    rpm_axis=[700 2000 4000 6000 7200],
    egt_table_k=[520 560 610 650 680
     600 660 730 790 820
     680 750 830 900 930
     720 810 900 970 1000],
    cooling_tau_s=1.8,
    gamma=1.33,
    gas_constant=287),
  blowdown=struct(
    evo_pressure_pa=350000,
    exhaust_temperature_k=1050,
    valve_area_m2=0.00075,
    attack_s=0.00025,
    fast_decay_s=0.0018,
    slow_decay_s=0.0055,
    fast_weight=0.72,
    pulse_sharpness=54),
  combustion_variation=struct(
    start_rpm=1400,
    full_rpm=5200,
    depth=0.25,
    correlation=0.32,
    timing_jitter_deg=2.4,
    timing_correlation=0.2,
    notch_probability=0.09,
    notch_depth=0.55,
    minimum_gain=0.35,
    maximum_gain=1.42,
    cylinder_gain=[1.03 0.96 1.01 0.94 1.04 0.97 1 0.95]),
  exhaust=struct(
    primary_left_m=[0.46 0.5 0.53 0.57],
    primary_right_m=[0.47 0.49 0.54 0.56],
    primary_diameter_m=0.041,
    collector_length_m=0.24,
    collector_diameter_m=0.06,
    catalyst_length_m=0.28,
    catalyst_diameter_m=0.068,
    midpipe_length_m=1.15,
    midpipe_diameter_m=0.06,
    muffler_main_length_m=0.42,
    muffler_bypass_length_m=0.62,
    tailpipe_length_m=0.52,
    tailpipe_diameter_m=0.0635,
    catalyst_reflection=-0.18,
    catalyst_transmission=0.72,
    crossover_coupling=0.2,
    muffler_reflection=-0.42,
    tail_reflection=-0.92,
    loss_frequency_hz=[125 500 2000 8000 16000],
    loss_db_per_m=[0.08 0.18 0.55 1.8 4.2],
    dry_gain=1,
    body_modes_hz=[88 178],
    body_q=[1.4 2.1],
    body_gain=[0.05 0.08]),
  afterfire=struct(
    egt_threshold_k=760,
    minimum_rpm=2600,
    overrun_duration_s=1.25,
    base_interval_s=0.029,
    cluster_size=8,
    calibration="c63_w204",
    body_hz=[92 146 178],
    metal_hz=[425 524 624 724 882],
    body_gain=0.58,
    metal_gain=0.82,
    crack_gain=1.78,
    attack_s=0.00035,
    body_decay_s=0.06,
    metal_decay_s=0.018,
    crack_decay_s=0.003),
  mix=struct(exhaust_gain=5.4, mechanical_gain=0.55, afterfire_gain=0.72, afterfire_peak_over_exhaust_db=7.67),
  rasp=struct(
    start_rpm=1700,
    full_rpm=5600,
    nonlinear_drive=3,
    nonlinear_gain=0.1,
    texture_gain=0.008,
    jitter_gain=0.22,
    jitter_hz=120,
    highpass_hz=1000,
    lowpass_hz=8500),
  induction=struct(enabled=false),
  mechanical=struct(orders=[32 56 88], band_gain_db=[-32 -38 -44], noise_gain_db=-48),
  propagation=struct(direct_distance_m=1, ground_delay_s=0.0048, ground_gain=-0.45, body_delay_s=0.0085, body_gain=-0.3))