% Simulink data dictionary hellcat_v6_params.sldd

HELLCAT_V6 = struct(
  schema="jovi.engine_sound.v6",
  name="hellcat",
  display_name="Dodge Challenger SRT Hellcat 6.2 Supercharged V8",
  seed=6208,
  audio=struct(sample_rate_hz=96000, export_sample_rate_hz=48000, peak_limit=0.89, master_gain=0.86),
  engine=struct(
    cylinders=8,
    cycle_revolutions=2,
    displacement_l=6.166,
    bore_m=0.1039,
    stroke_m=0.0909,
    compression_ratio=9.5,
    idle_rpm=750,
    redline_rpm=6200,
    firing_order=[1 8 4 3 6 5 7 2],
    bank_by_cylinder=[1 2 1 2 1 2 1 2],
    torque_rpm=[750 1500 2500 3500 4000 5000 5800 6200],
    torque_nm=[420 610 790 860 881 850 770 700],
    wiebe_a=5,
    wiebe_m=2,
    combustion_duration_deg=52,
    evo_deg_bbdc=48,
    equivalent_inertia_kgm2=0.28),
  driveline=struct(
    gear_ratios=[4.714 3.143 2.106],
    final_drive=2.62,
    wheel_radius_m=0.347,
    launch_rpm=2100,
    max_accel_mps2=7.8,
    shift_rpm=6100,
    shift_attack_s=0.025,
    shift_hold_s=0.045,
    shift_recovery_s=0.09,
    shift_settle_s=0.06,
    shift_min_torque=0.1,
    shift_reengage_gain=1.1),
  ecu=struct(
    full_load_spark_deg=[6 11 15 17 18],
    spark_rpm=[750 2000 3500 5000 6200],
    full_load_lambda=0.8,
    dfco_throttle=0.06,
    dfco_rpm=2200,
    dfco_delay_s=0.12,
    fuel_film_tau_s=0.18),
  thermal=struct(
    load_axis=[0.1 0.4 0.7 1],
    rpm_axis=[750 2000 3500 5000 6200],
    egt_table_k=[520 560 610 650 680
     600 660 730 790 820
     680 750 830 900 930
     740 840 930 1010 1050],
    cooling_tau_s=1.8,
    gamma=1.33,
    gas_constant=287),
  blowdown=struct(
    evo_pressure_pa=430000,
    exhaust_temperature_k=1100,
    valve_area_m2=0.00085,
    attack_s=0.00025,
    fast_decay_s=0.0018,
    slow_decay_s=0.0055,
    fast_weight=0.72,
    pulse_sharpness=30),
  combustion_variation=struct(
    start_rpm=1200,
    full_rpm=4500,
    depth=0.16,
    correlation=0.4,
    timing_jitter_deg=1.8,
    timing_correlation=0.25,
    notch_probability=0.045,
    notch_depth=0.35,
    minimum_gain=0.5,
    maximum_gain=1.35,
    cylinder_gain=[1.04 0.95 1 0.94 1.03 0.97 1.01 0.96]),
  exhaust=struct(
    primary_left_m=[0.42 0.47 0.52 0.56],
    primary_right_m=[0.43 0.46 0.53 0.55],
    primary_diameter_m=0.044,
    collector_length_m=0.27,
    collector_diameter_m=0.066,
    catalyst_length_m=0.31,
    catalyst_diameter_m=0.072,
    midpipe_length_m=1.32,
    midpipe_diameter_m=0.07,
    muffler_main_length_m=0.48,
    muffler_bypass_length_m=0.68,
    tailpipe_length_m=0.58,
    tailpipe_diameter_m=0.076,
    catalyst_reflection=-0.22,
    catalyst_transmission=0.68,
    crossover_coupling=0.14,
    muffler_reflection=-0.5,
    tail_reflection=-0.88,
    loss_frequency_hz=[125 500 2000 8000 16000],
    loss_db_per_m=[0.08 0.18 0.55 1.8 4.2],
    dry_gain=0.1,
    body_modes_hz=[62 76 145 246],
    body_q=[1.1 1.4 1.9 2.5],
    body_gain=[4 3 0.1 0]),
  afterfire=struct(
    egt_threshold_k=800,
    minimum_rpm=2400,
    overrun_duration_s=0.9,
    base_interval_s=0.08,
    cluster_size=5,
    calibration="hellcat",
    body_hz=[72 145 246],
    metal_hz=[246 340 434 545],
    body_gain=1.1,
    metal_gain=0.38,
    crack_gain=0.62,
    attack_s=0.0047,
    body_decay_s=0.12,
    metal_decay_s=0.045,
    crack_decay_s=0.006),
  mix=struct(exhaust_gain=4, mechanical_gain=0.65, afterfire_gain=0.58, afterfire_peak_over_exhaust_db=8.5),
  rasp=struct(
    start_rpm=1400,
    full_rpm=4800,
    nonlinear_drive=2.4,
    nonlinear_gain=0.045,
    texture_gain=0.004,
    jitter_gain=0.16,
    jitter_hz=90,
    highpass_hz=550,
    lowpass_hz=4500),
  induction=struct(enabled=true, speed_ratio=2.36, start_rpm=1500, orders=[3 6 9 12], gains=[0.165 0.33 0.242 0.132]),
  mechanical=struct(orders=[24 40 64], band_gain_db=[-34 -40 -46], noise_gain_db=-50),
  propagation=struct(direct_distance_m=1, ground_delay_s=0.0048, ground_gain=-0.45, body_delay_s=0.0085, body_gain=-0.3))